# Grasshopper definition 02_quad_mesh_densification_and_patterning.gh (Grasshopper 1.0.7)

# singular | compas_pattern
# Quad mesh densification and patterning
# Robin Oval
# rpho2@cam.ac.uk
# https://github.com/BlockResearchGroup/compas_pattern
mesh = Mesh(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)
fromrhinomesh = FromRhinoMesh(mesh_guid=mesh)  # -> mesh
# ---------- fromrhinomesh: Python ----------
from compas_pattern.rhino.grasshopper import gh_from_rhino_mesh
mesh = gh_from_rhino_mesh(mesh_guid)
# ---------- end fromrhinomesh ----------
coarsen = CoarsenQuadMesh(quad_mesh=fromrhinomesh)  # -> coarse_quad_mesh
# ---------- coarsen: Python ----------
from compas_pattern.rhino.grasshopper import gh_coarsening
coarse_quad_mesh = gh_coarsening(quad_mesh)
# ---------- end coarsen ----------
storestrips = StoreStrips(quad_mesh=coarsen)  # -> quad_mesh
# ---------- storestrips: Python ----------
from compas_pattern.rhino.grasshopper import gh_store_strips
quad_mesh = gh_store_strips(quad_mesh)
# ---------- end storestrips ----------
vertices = MeshVertices(mesh=storestrips)  # -> vertex_coordinates
# ---------- vertices: Python ----------
from compas_pattern.rhino.grasshopper import gh_vertices
vertex_coordinates = gh_vertices(mesh)
# ---------- end vertices ----------
strips = QuadMeshStrips(quad_mesh=storestrips)  # -> strip_edges, strip_closed
# ---------- strips: Python ----------
from compas_pattern.rhino.grasshopper import gh_strips
strip_edges, strip_closed = gh_strips(quad_mesh)
# ---------- end strips ----------
item = ListItem(List=vertices, Index=strips.strip_edges, Wrap=True)
item_2 = ListItem(List=item, Index=0, Wrap=True)  # -> Item, Item1
ln = Line(StartPoint=item_2.Item, EndPoint=item_2.Item1)
trim = TrimTree(Tree=ln, Depth=1)

target_length = Slider(1.2, range=0..2)
min_subdivision = Slider(1, range=0..10)

len = Length(Curve=trim)
avr = Average(Input=len)
division = Division(A=avr, B=target_length)
max = Maximum(A=division, B=min_subdivision)  # -> flatten(Result)
densify = DensifyQuadMesh(quad_mesh=storestrips, strips_subdivision=max)  # -> dense_quad_mesh; inputs strips_subdivision: list of Int32
# ---------- densify: Python ----------
from compas_pattern.rhino.grasshopper import gh_densifiying
dense_quad_mesh = gh_densifiying(quad_mesh, strips_subdivision)
# ---------- end densify ----------

k = Slider(10, range=0..100)
d = Slider(0.5, range=0..1)

srf = Surface(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)
cstrsmoothing = ConstrainedLaplacianSmoothing(mesh=densify, k=k, d=d, surface_constraint=srf)  # -> smooth_mesh; inputs k: Int32, point_constraints: list
# ---------- cstrsmoothing: Python ----------
from compas_pattern.rhino.grasshopper import gh_constrained_smoothing
smooth_mesh = gh_constrained_smoothing(mesh, k=k, damping=d, surface_constraint=surface_constraint, point_constraints=point_constraints)
# ---------- end cstrsmoothing ----------
list = ValueList({"seed", "dual", "join", "ambo", "kis", "needle", "zip", "truncate", "ortho", "expand", "gyro", "snub", "meta", "bevel"}, selected="gyro")
conway = ConwayOperator(mesh=cstrsmoothing, operator=list)  # -> polygonal_mesh
# ---------- conway: Python ----------
from compas_pattern.rhino.grasshopper import gh_conway
polygonal_mesh = gh_conway(mesh, operator)
# ---------- end conway ----------

k_2 = Slider(5, range=0..100)
d_2 = Slider(0.5, range=0..1)

cstrsmoothing_2 = ConstrainedLaplacianSmoothing(mesh=conway, k=k_2, d=d_2, surface_constraint=srf)  # -> smooth_mesh; inputs k: Int32, point_constraints: list; same code as cstrsmoothing
torhinomesh = ToRhinoMesh(mesh=cstrsmoothing_2)  # -> mesh_guid
# ---------- torhinomesh: Python ----------
from compas_pattern.rhino.grasshopper import gh_to_rhino_mesh
mesh_guid = gh_to_rhino_mesh(mesh)
# ---------- end torhinomesh ----------
vertices_2 = MeshVertices(mesh=cstrsmoothing_2)  # -> vertex_coordinates; same code as vertices
edges = MeshEdges(mesh=cstrsmoothing_2)  # -> edge_vertices
# ---------- edges: Python ----------
from compas_pattern.rhino.grasshopper import gh_edges
edge_vertices = gh_edges(mesh)
# ---------- end edges ----------
item_3 = ListItem(List=vertices_2, Index=edges, Wrap=True)
item_4 = ListItem(List=item_3, Index=0, Wrap=True)  # -> Item, Item1
ln_2 = Line(StartPoint=item_4.Item, EndPoint=item_4.Item1)
line = Line(ln_2)
