# Grasshopper definition 04_quad_mesh_topological_edit.gh (Grasshopper 1.0.7)

# singular | compas_pattern
# Quad-mesh topological edit
# Robin Oval
# rpho2@cam.ac.uk
# https://github.com/BlockResearchGroup/compas_pattern
mesh = Mesh(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)
fromrhinomesh = FromRhinoMesh(mesh_guid=mesh)  # -> mesh
# ---------- fromrhinomesh: Python ----------
from compas_pattern.rhino.grasshopper import gh_from_rhino_mesh
mesh = gh_from_rhino_mesh(mesh_guid)
# ---------- end fromrhinomesh ----------
storestrips = StoreStrips(quad_mesh=fromrhinomesh)  # -> quad_mesh
# ---------- storestrips: Python ----------
from compas_pattern.rhino.grasshopper import gh_store_strips
quad_mesh = gh_store_strips(quad_mesh)
# ---------- end storestrips ----------
vertices = MeshVertices(mesh=storestrips)  # -> vertex_coordinates
# ---------- vertices: Python ----------
from compas_pattern.rhino.grasshopper import gh_vertices
vertex_coordinates = gh_vertices(mesh)
# ---------- end vertices ----------
strips = QuadMeshStrips(quad_mesh=storestrips)  # -> strip_edges, strip_closed
# ---------- strips: Python ----------
from compas_pattern.rhino.grasshopper import gh_strips
strip_edges, strip_closed = gh_strips(quad_mesh)
# ---------- end strips ----------
item = ListItem(List=vertices, Index=strips.strip_edges, Wrap=True)
points = PointList(Points=vertices, Size=0.35)
item_2 = ListItem(List=item, Index=0, Wrap=True)  # -> Item, Item1

panel = Panel("""2
4
7""")
panel_2 = Panel("""15
14
13
17""")

ln = Line(StartPoint=item_2.Item, EndPoint=item_2.Item1)
panel_3 = Panel("""3
8""")
trim = TrimTree(Tree=ln, Depth=1)
entwine = Entwine(Branch00=panel, Branch01=panel_2, FlattenInputs=True)  # -> simplify(Result)
curvepoint = PointOnCurve(trim, parameter=0.5)
editstrip = EditQuadMeshStripTopology(mesh=storestrips, polyedges_to_add=entwine, strips_to_delete=panel_3)  # -> mesh; inputs polyedges_to_add: tree of Int32, strips_to_delete: list of Int32
# ---------- editstrip: Python ----------
from compas_pattern.rhino.grasshopper import gh_add_delete_strips
mesh = gh_add_delete_strips(mesh, polyedges_to_add, strips_to_delete)
# ---------- end editstrip ----------
pline = PolyLine(Vertices=curvepoint, Closed=strips.strip_closed)  # -> flatten(Polyline)
curvepoint_2 = PointOnCurve(pline, parameter=0.5)
preview = CustomPreview(Geometry=pline, Material=ColourSwatch(SwatchColor=RGB(0, 0, 255)))
points_2 = PointList(Points=curvepoint_2, Size=0.5)

k = Slider(3, range=0..100)
d = Slider(0.5, range=0..1)

srf = Surface(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)
cstrsmoothing = ConstrainedLaplacianSmoothing(mesh=editstrip, k=k, d=d, surface_constraint=srf)  # -> smooth_mesh; inputs k: Int32, point_constraints: list
# ---------- cstrsmoothing: Python ----------
from compas_pattern.rhino.grasshopper import gh_constrained_smoothing
smooth_mesh = gh_constrained_smoothing(mesh, k=k, damping=d, surface_constraint=surface_constraint, point_constraints=point_constraints)
# ---------- end cstrsmoothing ----------
vertices_2 = MeshVertices(mesh=cstrsmoothing)  # -> vertex_coordinates; same code as vertices
singularities = QuadMeshSingularities(quad_mesh=cstrsmoothing)  # -> singularities
# ---------- singularities: Python ----------
from compas_pattern.rhino.grasshopper import gh_singularities
singularities = gh_singularities(quad_mesh)
# ---------- end singularities ----------
torhinomesh = ToRhinoMesh(mesh=cstrsmoothing)  # -> mesh_guid
# ---------- torhinomesh: Python ----------
from compas_pattern.rhino.grasshopper import gh_to_rhino_mesh
mesh_guid = gh_to_rhino_mesh(mesh)
# ---------- end torhinomesh ----------
X = UnitX(Factor=Slider(11, range=0..100))
item_3 = ListItem(List=vertices_2, Index=singularities, Wrap=True)
move = Move(Geometry=torhinomesh, Motion=X)  # -> Geometry, Transform
move_2 = Move(Geometry=item_3, Motion=X)  # -> Geometry, Transform
mesh_2 = Mesh(move.Geometry)
circle = CircleCNR(Center=move_2.Geometry, Normal=Vector(0, 0, 1), Radius=Slider(0.2, range=0..1))
boundary = BoundarySurfaces(Edges=circle)
preview_2 = CustomPreview(Geometry=boundary, Material=ColourSwatch(SwatchColor=RGB(255, 0, 255)))
